# Dynamo custom node Convert Builtin Category Name to Normal Name.dyf (Dynamo 0.8.2.2392)
# category: Bakery.Categories

get_categories_with_builtins = Custom[Get Categories with Builtins]()  # Lists: Category Names, internal api definition, Built In Category Names, Ids
builtInName = Input()
create = List.Create(builtInName)
bv_if_equal_return_index = Custom[bv If Equal Return Index](listA=create, listB=get_categories_with_builtins.Builtin_Name)  # forked
getItemAtIndex = List.GetItemAtIndex(list=get_categories_with_builtins.Names, index=bv_if_equal_return_index)
categoryName = Output(getItemAtIndex)
