# Dynamo custom node Convert Category Name to Built In Category Name.dyf (Dynamo 0.8.2.2392)
# category: Bakery.Categories
# You must use List.Map to convert list of Category Names to list of Built In Names

get_categories_with_builtins = Custom[Get Categories with Builtins]()  # Lists: Category Names, internal api definition, Built In Category Names, Ids
categoryName = Input()
create = List.Create(categoryName)
bv_if_equal_return_index = Custom[bv If Equal Return Index](listA=create, listB=get_categories_with_builtins.Names)  # forked
getItemAtIndex = List.GetItemAtIndex(list=get_categories_with_builtins.Builtin_Name, index=bv_if_equal_return_index)
builtInName = Output(getItemAtIndex)
