# Dynamo custom node Get Current Model Datum Information.dyf (Dynamo 0.9.1.4062)
# category: Bakery.DocInfo
# including base points, grids, levels

categories = Categories("ProjectBasePoint")
all_elements_of_category = ElementsOfCategory(categories)
watch = Watch(all_elements_of_category)
string_from_object = FromObject(watch)
id = Element.Id(watch)
string_from_object_2 = FromObject(id)
parameters = Element.Parameters(watch)
flatten = Flatten(parameters)
flat_list_to_list_of_strings = Custom[Flat List to List of Strings](Original_List=flatten)  # using python methods
addItemToFront = List.AddItemToFront(item=string_from_object_2, list=flat_list_to_list_of_strings)
addItemToFront_2 = List.AddItemToFront(item=string_from_object, list=addItemToFront)
flatten_2 = Flatten(addItemToFront_2)
categories_2 = Categories("SitePoint")
all_elements_of_category_2 = ElementsOfCategory(categories_2)
watch_2 = Watch(all_elements_of_category_2)
isEmpty = List.IsEmpty(watch_2)
string = StringInput("No Site Survey Point")
parameters_2 = Element.Parameters(watch_2)
if_ = If(test=isEmpty, true=string, false=parameters_2)
watch_3 = Watch(if_)
turnIntoList = Custom[TurnIntoList](unknownItem=watch_3)  # Turns an element (or a nested list) into a flat list
flat_list_to_list_of_strings_2 = Custom[Flat List to List of Strings](Original_List=turnIntoList)
string_2 = StringInput("Level Names")
categories_3 = Categories("Levels")
all_elements_of_category_3 = ElementsOfCategory(categories_3)
watch_4 = Watch(all_elements_of_category_3)
element_name_universal = Custom[Element Name Universal](Element_s=watch_4)  # Modified for 0.8.1
addItemToFront_3 = List.AddItemToFront(item=string_2, list=element_name_universal)
string_3 = StringInput("Level Elevations")
elevation = Level.Elevation(watch_4)
string_from_object_3 = FromObject(elevation)
addItemToFront_4 = List.AddItemToFront(item=string_3, list=string_from_object_3)
string_4 = StringInput("Grid Names")
categories_4 = Categories("Grids")
all_elements_of_category_4 = ElementsOfCategory(categories_4)
watch_5 = Watch(all_elements_of_category_4)
element_name_universal_2 = Custom[Element Name Universal](Element_s=watch_5)
addItemToFront_5 = List.AddItemToFront(item=string_4, list=element_name_universal_2)
create = List.Create(flatten_2, flat_list_to_list_of_strings_2, addItemToFront_3, addItemToFront_4, addItemToFront_5)
transpose = List.Transpose(create)
string_5 = StringInput("NullValueReplaced")
replaceNulls = Lists.Manage.ReplaceNulls(transpose, string_5)
n2d_list = Output(replaceNulls)  # "2d list"
level_elements = Output(all_elements_of_category_3)
grid_elements = Output(all_elements_of_category_4)
