# Dynamo custom node Show Dependency Nodes for one DYF.dyf (Dynamo 0.8.0.950)
# category: Bakery.Standalone
# used with List.Map for a folder of them

path_to_DYF = Input()
fromPath = FileObject(path_to_DYF)  # "File.FromPath"
readText = File.ReadText(fromPath)
code_block = CodeBlock { "nickname="; }
code_block_2 = CodeBlock { " x="; }
split = String.Split(readText, code_block, code_block_2)
code_block_3 = CodeBlock { 2; }
code_block_4 = CodeBlock { 1; }
dropEveryNthItem = List.DropEveryNthItem(list=split, n=code_block_3, offset=code_block_4)
uniqueItems = List.UniqueItems(dropEveryNthItem)
code_block_5 = CodeBlock { 0; }
code_block_6 = CodeBlock { 1; }
remove = String.Remove(str=uniqueItems, startIndex=code_block_5, count=code_block_6)
length = String.Length(remove)
code_block_7 = CodeBlock(x=length) { x-1; }
code_block_8 = CodeBlock { 1; }
remove_2 = String.Remove(str=remove, startIndex=code_block_7, count=code_block_8)
names = Output(remove_2)
