# Dynamo custom node bv IDs to Elements.dyf (Dynamo 1.2.0.2690)
# category: Bakery.Forks
# forked from CAAD_RWTH

IDs = Input()
id_to_element = Custom[Id to Element](Id=IDs)  # Selects elements in a model from id input (ElementId, string, integer or GUID)
Element_s = Output(id_to_element)  # "Element(s)"
